# Grasshopper definition __coding_workshop.gh (Grasshopper 1.0.7)

# ---- group: Option 2
curve = Curve(<curve referenced from the Rhino model>)
file_path = FilePath("C:\Users\mhelmrei\Documents\projects\ar_rhino\algorithms.py")
read_file = ReadFile(File=file_path, PerLineParse=False)  # -> Content
#   port File: Uri of file to read
# ---------- read_file: VB line parser ----------
    action = GH_LineParserAction.Include
    Return line

    'Parse the line and return some data that represents the line.
    'If the line cannot be parsed, you can return Nothing and
    'assign a different action.
    'The default implementation is to just return the line itself.
    'If you return types that implement IGH_Goo, this component
    'will work substantially faster.
# ---------- end read_file ----------
ghpython_script = GhPythonScript(Code=read_file, Polygon=curve)
panel = Panel(ghpython_script)

# ----
execute = Button()

# ---- group: Exports a building plan file structure, including folder structure, obj and json
panel_2 = Panel("C:\Users\mhelmrei\Desktop\ETH_AR_Innosuisse\__building_plan_example")
buildingplan = PythonScript(export_data=execute, filepath=panel_2)  # -> out
# ---------- buildingplan: Python ----------
import compas
from compas.datastructures import Mesh
from compas.geometry import Point, Frame


import uuid
import json, os
import math as m

import Rhino
import Rhino.Geometry as rg
import rhinoscriptsyntax as rs
import scriptcontext as sc

import ghpythonlib.components as ghcomp


filepath_name_parts = filepath.split('\\')
building_plan_name = filepath_name_parts[-1]
sc.doc = Rhino.RhinoDoc.ActiveDoc

# ==============================================================================
# Create folder structure for path
# ==============================================================================

folders = ['building_elements','instructions']

for folder in folders:
    path_folder = os.path.join(filepath,folder)
    
    if os.path.isdir(path_folder):
        print("Folder '%s' exists." % (folder))
    else:
        print("Folder '%s' doesnt exists. Creating folder '%s'." % (folder, folder))
        os.mkdir(os.path.join(path_folder))


lists_of_elements = []
counter_comb_meshes = 1
dict_instruction_elements = {}


# ==============================================================================
# Catch Instructions from 3D and Layer
# ==============================================================================
layer_children = rs.LayerChildren("3D_Building_Steps")

string_list_building_steps_layer_children = [string_layer_child.split("::")[-1] for string_layer_child in layer_children]


_BuildingSteps = []
_BuildingSteps_ObjectNames =[]

for string_layer in string_list_building_steps_layer_children:
    if not ghcomp.EleFront.ReferencebyLayer(string_layer) == None:
        if not type(ghcomp.EleFront.ReferencebyLayer(string_layer)) == type([]):
            _BuildingSteps.append(ghcomp.EleFront.ReferencebyLayer(string_layer))
            _BuildingSteps_ObjectNames.append(rs.ObjectsByLayer(string_layer))
        else:
            _BuildingSteps.extend(ghcomp.EleFront.ReferencebyLayer(string_layer))
            _BuildingSteps_ObjectNames.extend(rs.ObjectsByLayer(string_layer))

_Instructions_of_Type_Dimensions = []
_Instructions_of_Type_Dimensions_ObjectNames =[]

_Instructions_of_Type_Text = []
_Instructions_of_Type_Text_ObjectNames =[]


_Instructions_of_Type_Model = []
_Instructions_of_Type_Model_ObjectNames =[]


list =  rs.LayerNames()

for current_layer in list:
    if not len(current_layer.split("::")) == 1:
        layer_name = current_layer.split("::")[-1]
        if layer_name == "3D_Instructions_Text":
            if not type(ghcomp.EleFront.ReferencebyLayer(current_layer)) == type([]):
                _Instructions_of_Type_Text.append(ghcomp.EleFront.ReferencebyLayer(current_layer))
                _Instructions_of_Type_Text_ObjectNames.append(rs.ObjectsByLayer(current_layer))
            else:
                _Instructions_of_Type_Text.extend(ghcomp.EleFront.ReferencebyLayer(current_layer))
                _Instructions_of_Type_Text_ObjectNames.extend(rs.ObjectsByLayer(current_layer))
        elif layer_name == "3D_Instructions_Model":
            if not type(ghcomp.EleFront.ReferencebyLayer(current_layer)) == type([]):
                _Instructions_of_Type_Model.append(ghcomp.EleFront.ReferencebyLayer(current_layer))
                _Instructions_of_Type_Model_ObjectNames.append(rs.ObjectsByLayer(current_layer))
            else:
                _Instructions_of_Type_Model.extend(ghcomp.EleFront.ReferencebyLayer(current_layer))
                _Instructions_of_Type_Model_ObjectNames.extend(rs.ObjectsByLayer(current_layer))
        elif layer_name == "3D_Instructions_Dim":
            if not type(ghcomp.EleFront.ReferencebyLayer(current_layer)) == type([]):
                _Instructions_of_Type_Dimensions.append(ghcomp.EleFront.ReferencebyLayer(current_layer))
                _Instructions_of_Type_Dimensions_ObjectNames.append(rs.ObjectsByLayer(current_layer))
            else:
                _Instructions_of_Type_Dimensions.extend(ghcomp.EleFront.ReferencebyLayer(current_layer))
                _Instructions_of_Type_Dimensions_ObjectNames.extend(rs.ObjectsByLayer(current_layer))
from random import randint



def rh_building_step_to_data(i, building_step):
    """Extracts data from a Rhino Mesh Entity
    
    Parameters
    ----------
    text_entity
        Rhino Text Entity
        
    Returns
    -------
    current_name
        Rhino Object name of the text entity
        
    text
        Text displayed
    
    c_text_plane
        Compas plane in WCS (origin, xaxis, yaxis)
    
    bool_show_on_projector
        Boolean if information is shown on projector or not
    
    
    """


    faces_list = [[face.A, face.B, face.C] for face in building_step.Faces]
    vertices_list = [[vert.X, vert.Y, vert.Z] for vert in building_step.Vertices]

    obj_name = rs.ObjectName(_BuildingSteps_ObjectNames[i])
    obj_name = obj_name.split(" ")[-1] + ".obj"

    compas_mesh = Mesh.from_vertices_and_faces(vertices_list, faces_list)

    instruction_obj_path = os.path.join(filepath, "building_elements", obj_name)
    compas_mesh.to_obj(instruction_obj_path)

    model_key = obj_name
    pos = [0.0, 0.0, 0.0]
    quat = [1.0, 0., 0., 0.]
    texture_file = ""
    
    r, g, b = rs.ObjectColor(_BuildingSteps_ObjectNames[i]).R, rs.ObjectColor(_BuildingSteps_ObjectNames[i]).G, rs.ObjectColor(_BuildingSteps_ObjectNames[i]).B

    if [r, g, b] == [0,0,0]:
        r = randint(0, 255)
        g = randint(0, 255)
        b = randint(0, 255)
        
    color = [r/255, g/255, b/255]

    id = str(uuid.uuid1())
    id = obj_name.split(" ")[-1]

    current_name_model = rs.ObjectName(_BuildingSteps_ObjectNames[i])
    name_parts_current_name = current_name_model.split(' ')
    
    if i == 0: is_already_built = True
    else: is_already_built = False
    
    json_dict = {}
    json_dict["depends"] = []
    json_dict["id"] = id
    json_dict["is_already_built"] = is_already_built
    json_dict["object_type"] = model_key
    json_dict["pos.x"] =  0.0
    json_dict["pos.y"]= 0.0
    json_dict["pos.z"]= 0.0
    json_dict["quat.w"]= 1.0
    json_dict["quat.x"]= 0.0
    json_dict["quat.y"]= 0.0
    json_dict["quat.z"]= 0.0
    json_dict["build_instructions"] = []
    json_dict["type"] = "object"
    json_dict["color_rgb"] = color
    return json_dict
    
def rh_dimension_to_data(i, linear_dimension):
    """Extracts data from a Rhino Dimension
    
    Parameters
    ----------
    linear_dimension
        Rhino Linear Dimension Object
        
    Returns
    -------
    current_name
        Rhino Object name of the text entity
        
    start_pt
        Rhino Point of the dimension in WCS (x,y,z)
    
    end_pt
        Rhino point of the dimension in WCS (x,y,z)
        
    text
        Text displayed in dimension (string)
    
    c_text_plane
        Text plane in WCS (origin, xaxis, yaxis)
    
    bool_show_on_projector
        Boolean if information is shown on projector or not
    
    
    """

    start_pt = rg.Point3d(linear_dimension.Get3dPoints()[4])
    p1 = rg.Point3d(linear_dimension.Get3dPoints()[1])
    p2 = rg.Point3d(linear_dimension.Get3dPoints()[2])
    dim_vec = rs.VectorCreate(p1, p2)
    
    end_pt = start_pt + dim_vec
    current_name = rs.ObjectName(_Instructions_of_Type_Dimensions_ObjectNames[i])
    plane = linear_dimension.Plane

    if plane.ZAxis[2] < 0:
        plane.Rotate(m.radians(180), plane.XAxis, plane.Origin)


    c_text_plane = Frame(Point(plane.Origin[0],plane.Origin[1],plane.Origin[2]), [plane.XAxis[0], plane.XAxis[1], plane.XAxis[2]], [plane.YAxis[0], plane.YAxis[1], plane.YAxis[2]]) 
    text = linear_dimension.Text
    quat = c_text_plane.quaternion
    color = [1.0, 0.0, 0.0, 0.0]
    name_parts_current_name = current_name.split(' ')
    bool_show_on_projector = True
    
    id = str(uuid.uuid1())
    r, g, b = rs.ObjectColor(_Instructions_of_Type_Dimensions_ObjectNames[i]).R, rs.ObjectColor(_Instructions_of_Type_Dimensions_ObjectNames[i]).G, rs.ObjectColor(_Instructions_of_Type_Dimensions_ObjectNames[i]).B

    if [r, g, b] == [0,0,0]:
        r = randint(0, 255)
        g = randint(0, 255)
        b = randint(0, 255)
        
    color = [r/255, g/255, b/255, 1.0]
    json_dict = {}
    json_dict["instruction_type"] = "linear_dimension"
    json_dict["id"] = id
    json_dict["start_pos"] = [start_pt.X, start_pt.Y, start_pt.Z]
    json_dict["end_pos"] = [end_pt.X, end_pt.Y, end_pt.Z]
    json_dict["quat"] = [quat[0], quat[1], quat[2], quat[3]]
    json_dict["color"] = color
    json_dict["offset"] = 0.075
    json_dict["char_size"] = 0.06
    json_dict["show_on_projector"] = bool_show_on_projector

    return json_dict
def rh_text_entity_to_data(i, text_entity):
    """Extracts data from a Rhino Text Entity
    
    Parameters
    ----------
    text_entity
        Rhino Text Entity
        
    Returns
    -------
    current_name
        Rhino Object name of the text entity
        
    text
        Text displayed
    
    c_text_plane
        Compas plane in WCS (origin, xaxis, yaxis)
    
    bool_show_on_projector
        Boolean if information is shown on projector or not
    
    
    """
    
    plane = text_entity.Plane
    
    if plane.ZAxis[2] < 0:
        plane.Rotate(m.radians(180), plane.XAxis, plane.Origin)

    c_text_plane = Frame(Point(plane.Origin[0],plane.Origin[1],plane.Origin[2]), [plane.XAxis[0], plane.XAxis[1], plane.XAxis[2]], [plane.YAxis[0], plane.YAxis[1], plane.YAxis[2]]) 
    quat = c_text_plane.quaternion
    
    pos = [plane.Origin[0],plane.Origin[1],plane.Origin[2]]
    text = text_entity.Text
    text_height = text_entity.TextHeight
    
    if text_height < 0.06:
        text_height = 0.06
        
    current_name = rs.ObjectName(_Instructions_of_Type_Text_ObjectNames[i])
    name_parts_current_name = current_name.split(' ')
    bool_show_on_projector = True
    r, g, b = rs.ObjectColor(_Instructions_of_Type_Text_ObjectNames[i]).R, rs.ObjectColor(_Instructions_of_Type_Text_ObjectNames[i]).G, rs.ObjectColor(_Instructions_of_Type_Text_ObjectNames[i]).B

    if [r, g, b] == [0,0,0]:
        r = randint(0, 255)
        g = randint(0, 255)
        b = randint(0, 255)
        
    color = [r/255, g/255, b/255, 1.0]
    id = str(uuid.uuid1())
    json_dict = {}
    json_dict["instruction_type"] = "text_box_3d"
    json_dict["id"] = id

    json_dict["text"] = text
    json_dict["size"] = text_height

    json_dict["pos"] = [pos[0], pos[1], pos[2]]
    json_dict["quat"] = [quat[0], quat[1], quat[2], quat[3]]
    json_dict["show_on_projector"] = bool_show_on_projector
    json_dict["color"] = color
    return json_dict
    
def rh_mesh_entity_to_data(i, mesh_entity):
    """Extracts data from a Rhino Mesh Entity
    
    Parameters
    ----------
    text_entity
        Rhino Text Entity
        
    Returns
    -------
    current_name
        Rhino Object name of the text entity
        
    text
        Text displayed
    
    c_text_plane
        Compas plane in WCS (origin, xaxis, yaxis)
    
    bool_show_on_projector
        Boolean if information is shown on projector or not
    
    
    """


    faces_list = [[face.A, face.B, face.C] for face in mesh_entity.Faces]
    vertices_list = [[vert.X, vert.Y, vert.Z] for vert in mesh_entity.Vertices]
    object_name = rs.ObjectName(_Instructions_of_Type_Model_ObjectNames[i])
    obj_name = rs.ObjectName(_Instructions_of_Type_Model_ObjectNames[i])

    obj_name = obj_name.split(" ")[-1] + "_" + obj_name.split(" ")[-2] + ".obj"
    compas_mesh = Mesh.from_vertices_and_faces(vertices_list, faces_list)

    instruction_obj_path = os.path.join(filepath, "instructions", obj_name)
    compas_mesh.to_obj(instruction_obj_path)

    instruction_type = "model_instruction"
    model_key = obj_name
    pos = [0.0, 0.0, 0.0]
    quat = [1.0, 0., 0., 0.]
    texture_file = ""
    r, g, b = rs.ObjectColor(_Instructions_of_Type_Model_ObjectNames[i]).R, rs.ObjectColor(_Instructions_of_Type_Model_ObjectNames[i]).G, rs.ObjectColor(_Instructions_of_Type_Model_ObjectNames[i]).B

    if [r, g, b] == [0,0,0]:
        r = randint(0, 255)
        g = randint(0, 255)
        b = randint(0, 255)
        
    color = [r/255, g/255, b/255, 1.0]

    id = str(uuid.uuid1())

    current_name_model = rs.ObjectName(_Instructions_of_Type_Text_ObjectNames[i])
    name_parts_current_name = current_name_model.split(' ')

    json_dict = {}
    json_dict["instruction_type"] = "model_instruction"
    json_dict["id"] = id

    json_dict["model_key"] = model_key

    json_dict["pos"] = [pos[0], pos[1], pos[2]]
    json_dict["quat"] = [quat[0], quat[1], quat[2], quat[3]]
    json_dict["texture_file"] = texture_file
    json_dict["show_on_projector"] = True
    json_dict["color"] = color


    return json_dict

# ==============================================================================
# Loop through dimension entities
# ==============================================================================



for i, building_step in enumerate(_BuildingSteps):
    #extract information from dimension
    json_dictionary_bs = rh_building_step_to_data(i, building_step)
    current_name_model = rs.ObjectName((_BuildingSteps_ObjectNames[i]))
    name_parts_current_name = current_name_model.split(' ')
    
    building_step_name = name_parts_current_name[1]
    dict_instruction_elements[building_step_name] = {"data": json_dictionary_bs, "build_instructions": []}


for i, linear_dimension in enumerate(_Instructions_of_Type_Dimensions):
    #extract information from dimension
    if linear_dimension == None: continue
    json_dictionary_dim = rh_dimension_to_data(i, linear_dimension)
    current_name_model = rs.ObjectName((_Instructions_of_Type_Dimensions_ObjectNames[i]))
    name_parts_current_name = current_name_model.split(' ')
    
    building_step_name = name_parts_current_name[2]
    instruction_name = name_parts_current_name[3]
    #append information to dictionary
    if not building_step_name in dict_instruction_elements:
        print(("INFO :: BUILDING STEP :: {} not found! Layer doesn't contain any objects!").format(building_step_name))
        continue
    dict_instruction_elements[building_step_name]["build_instructions"].append(json_dictionary_dim)

# ==============================================================================
# Loop through text entities
# ==============================================================================

for i, text_entity in enumerate(_Instructions_of_Type_Text):
    #extract information from text
    if text_entity == None: continue
    json_dictionary_text = rh_text_entity_to_data(i, text_entity)
    
    current_name_model = rs.ObjectName((_Instructions_of_Type_Text_ObjectNames[i]))
    name_parts_current_name = current_name_model.split(' ')
    
    building_step_name = name_parts_current_name[2]
    instruction_name = name_parts_current_name[3]
    #append information to dictionary
    if not building_step_name in dict_instruction_elements:
        print(("INFO :: BUILDING STEP :: {} not found! Layer doesn't contain any objects!").format(building_step_name))
        continue
    dict_instruction_elements[building_step_name]["build_instructions"].append(json_dictionary_text)

# ==============================================================================
# Loop through model entities
# ==============================================================================


for i, mesh_entity in enumerate(_Instructions_of_Type_Model):
    #extract information from text
    if mesh_entity == None: continue
    json_dictionary_mesh = rh_mesh_entity_to_data(i, mesh_entity)
    
    current_name_model = rs.ObjectName((_Instructions_of_Type_Model_ObjectNames[i]))
    name_parts_current_name = current_name_model.split(' ')
    
    building_step_name = name_parts_current_name[2]

    instruction_name = name_parts_current_name[3]
    if not building_step_name in dict_instruction_elements:
        print(("INFO :: BUILDING STEP :: {} not found! Layer doesn't contain any objects!").format(building_step_name))
        continue
    dict_instruction_elements[building_step_name]["build_instructions"].append(json_dictionary_mesh)


# ==============================================================================
# Export building plan // JSON
# ==============================================================================


def write_building_plan_to_json(dict_instruction_elements, output_file):
    building_steps = []
    for i, building_step_key in enumerate(sorted(dict_instruction_elements.keys())):
        building_step = dict_instruction_elements[building_step_key]["data"]
        building_step["build_instructions"].extend(dict_instruction_elements[building_step_key]["build_instructions"])
        building_steps.append(building_step)

    if export_data == True:
        with open(os.path.join(filepath, output_file), 'w') as file:
            json.dump({ "options" : {
      "add_new_objects_as_fixed": True
  },"building_steps": building_steps}, file, indent=2, sort_keys= True)

            
if __name__ == "__main__":
    write_building_plan_to_json(dict_instruction_elements, building_plan_name +".json")
    print("Done")
# ---------- end buildingplan ----------

# ---- group: Option 1
curve_2 = Curve(<curve referenced from the Rhino model>)
ghpython_script_2 = GhPythonScript(polygon=curve_2)  # -> a; inputs polygon: Polyline
# ---------- ghpython_script_2: Python ----------
def polygon_area(vertices):
    n = len(vertices)
    area = 0.0
    for i in range(n):
        j = (i + 1) % n
        area += vertices[i][0] * vertices[j][1] - vertices[j][0] * vertices[i][1]
    return abs(area / 2)


a = polygon_area(polygon)
# ---------- end ghpython_script_2 ----------
panel_3 = Panel(ghpython_script_2)

# ---- group: Option 3
curve_3 = Curve(<curve referenced from the Rhino model>)
ghpython_script_3 = GhPythonScript(polygon=curve_3)  # -> a; inputs polygon: Polyline
# ---------- ghpython_script_3: Python ----------
from algorithms import polygon_area

a = polygon_area(polygon)
# ---------- end ghpython_script_3 ----------
panel_4 = Panel(ghpython_script_3)

# ---- group: Option 4
ghpython_script_4 = GhPythonScript(reload=Button())  # inputs reload: Boolean
# ---------- ghpython_script_4: Python ----------
import os, sys
from compas_rhino import unload_modules

ghcanvas =ghenv.Component.OnPingDocument()
folder = os.path.dirname(ghcanvas.FilePath)

if folder not in sys.path:
    sys.path.append(folder)

if reload:
    mods = unload_modules("algor")
    print ("Unloaded {} modules".format(len(mods)))
# ---------- end ghpython_script_4 ----------

# ----
panel_5 = Panel(buildingplan)
